# Grasshopper definition twistedBuilding.gh (Grasshopper 1.0.7)
# plug-ins: GH TSD

# ---- group: Geometry input
column_spacing_x = Slider(5, range=5..50)
column_spacing_y = Slider(5, range=5..50)
height = Slider(33, range=5..50)
twist_angle = Slider(20, range=0..180)
building_breadth = Slider(25, range=5..50)
buidling_width = Slider(35, range=5..50)
core_y = Slider(5, range=5..50)
core_x = Slider(5, range=5..50)

# ---- group: Solid box
domain_box = DomainBox(Base=PlaneXY(0, 0, 0), X=building_breadth, Y=buidling_width, Z=height)
deconstruct_brep = DeconstructBrep(Brep=domain_box)  # -> Faces, Edges, Vertices
list_item = ListItem(List=deconstruct_brep.Faces, Index=Slider(4, range=0..5), Wrap=True)
md_slider = MDSlider(
    SliderMode=0,
    slider_value=Point(0.5040312976, 0.5002099014, 0.5),
    x_domain=Domain(0, 1),
    y_domain=Domain(0, 1),
    z_domain=Domain(0, 1))
unit_z = UnitZ(Factor=1)
evaluate_surface = EvaluateSurface(Surface=reparameterize(list_item), Point=md_slider)  # -> Point, Normal, UDirection, VDirection, Frame
project_point = ProjectPoint(Point=evaluate_surface.Point, Direction=unit_z, Geometry=domain_box)  # -> Point, Index
line = Line(StartPoint=evaluate_surface.Point, EndPoint=project_point.Point)
construct_domain = ConstructDomain(DomainStart=Slider(0, range=0..1), DomainEnd=Slider(1, range=0..1))
boolean_toggle = BooleanToggle(False)
boolean_toggle_2 = BooleanToggle(False)
sub_curve = SubCurve(BaseCurve=reparameterize(line), Domain=construct_domain)
twist = Twist(Geometry=domain_box, Axis=sub_curve, Angle=degrees(twist_angle), Infinite=boolean_toggle, Rigid=boolean_toggle_2)

# ---- group: Walls
vector_xyz = VectorXYZ(XComponent=core_x, YComponent=core_y, ZComponent=0)  # -> Vector, Length
number = Number(-0.5)
scale = Scale(Geometry=vector_xyz.Vector, Center=Point(0, 0, 0), Factor=number)  # -> Geometry, Transform
domain_box_2 = DomainBox(Base=evaluate_surface.Point, X=core_x, Y=core_y, Z=height)
move = Move(Geometry=domain_box_2, Motion=scale.Geometry)  # -> Geometry, Transform
panel = Panel("""4
5""")
deconstruct_brep_2 = DeconstructBrep(Brep=move.Geometry)  # -> Faces, Edges, Vertices
cull_index = CullIndex(List=flatten(deconstruct_brep_2.Faces), Indices=panel, Wrap=True)
colour_rgb = ColourRGB(Alpha=255, Red=150, Green=150, Blue=0)
custom_preview = CustomPreview(Geometry=cull_index, Material=colour_rgb)

# ---- group: Divide into floor surfaces
deconstruct_brep_3 = DeconstructBrep(Brep=domain_box)  # -> Faces, Edges, Vertices
list_item_2 = ListItem(List=deconstruct_brep_3.Faces, Index=Slider(4, range=0..5), Wrap=True)
evaluate_surface_2 = EvaluateSurface(Surface=reparameterize(list_item_2), Point=md_slider)  # -> Point, Normal, UDirection, VDirection, Frame
scale_2 = Scale(Geometry=list_item_2, Center=evaluate_surface_2.Point, Factor=Slider(2, range=0..10))  # -> Geometry, Transform
construct_domain_2 = ConstructDomain(DomainStart=Slider(0, range=0..100), DomainEnd=height)
floor_spacing = Slider(3, range=0..10)
division = Division(A=height, B=floor_spacing)
number_2 = Number(-1)
range = Range(Domain=construct_domain_2, Steps=division)
multiplication = Multiplication(A=range, B=number_2)
offset_surface = OffsetSurface(Surface=scale_2.Geometry, Distance=multiplication, Retrim=True)

# ----
unit_z_2 = UnitZ(Factor=1)

# ---- group: Slabs
# Make slabs slightly bigger
brep_join = BrepJoin(Breps=twist)  # -> Breps, Closed
brep_brep = BrepBrep(BrepA=brep_join.Breps, BrepB=offset_surface)  # -> Curves, Points
surface = Surface(brep_brep.Curves)
colour_rgb_2 = ColourRGB(Alpha=255, Red=50, Green=150, Blue=200)
area = Area(Geometry=brep_brep.Curves)  # -> Area, Centroid
custom_preview_2 = CustomPreview(Geometry=surface, Material=colour_rgb_2)
number_slider = Slider(1.1, range=0..2)
plane_origin = PlaneOrigin(Base=surface, Origin=area.Centroid)
scale_nu = ScaleNU(Geometry=brep_brep.Curves, Plane=plane_origin, ScaleX=number_slider, ScaleY=number_slider, ScaleZ=1)  # -> Geometry, Transform
cull_index_2 = CullIndex(List=flatten(scale_nu.Geometry), Indices="0", Wrap=True)

# ---- group: Columns
integer_division = IntegerDivision(A=buidling_width, B=column_spacing_y)
integer_division_2 = IntegerDivision(A=building_breadth, B=column_spacing_x)
rectangular = Rectangular(
    Plane=PlaneXY(0, 0, 0),
    SizeX=column_spacing_x,
    SizeY=column_spacing_y,
    ExtentX=integer_division_2,
    ExtentY=integer_division)  # -> Cells, Points
panel_2 = Panel("Top slab plane")
list_item_3 = ListItem(List=flatten(surface), Index="-1", Wrap=True)
planar = Planar(Curve=list_item_3)  # -> Planar, Plane, Deviation
project_point_2 = ProjectPoint(Point=rectangular.Points, Direction=unit_z_2, Geometry=planar.Plane)  # -> Point, Index
line_2 = Line(StartPoint=rectangular.Points, EndPoint=project_point_2.Point)
panel_3 = Panel("Column curves")
twist_2 = Twist(Geometry=line_2, Axis=sub_curve, Angle=degrees(twist_angle), Infinite=boolean_toggle, Rigid=boolean_toggle_2)

# ---- group: remove columns close to walls
# Remove columns close to the core walls
panel_4 = Panel("{0.5,0.5,0}")
evaluate_surface_3 = EvaluateSurface(Surface=reparameterize(cull_index), Point=panel_4)  # -> Point, Normal, UDirection, VDirection, Frame
scale_3 = Scale(Geometry=evaluate_surface_3.Normal, Center=Point(0, 0, 0), Factor=2)  # -> Geometry, Transform
extrude = Extrude(Base=cull_index, Direction=scale_3.Geometry)
collision_one_many = CollisionOneMany(Collider=twist_2, Obstacles=extrude)  # -> flatten(Collision), Index
booleans_to_indices = GhPythonScript(bools=flatten(collision_one_many.Collision))  # -> out, indices; inputs bools: list of Boolean
# ---------- booleans_to_indices: Python ----------
__author__ = "MullerT"
__version__ = "2022.10.01"

import rhinoscriptsyntax as rs

indicesToRemove = []

print "bools:"
print bools

index = 0;
for bool in bools:
    print bool
    if bool: 
      print "appending"
      indicesToRemove.append(index)
    index = index+1


print indicesToRemove
indices = []
indices = indicesToRemove
# ---------- end booleans_to_indices ----------
cull_index_3 = CullIndex(List=flatten(twist_2), Indices=booleans_to_indices.indices, Wrap=True)
panel_5 = Panel(collision_one_many.Collision)
panel_6 = Panel(booleans_to_indices.out)

# ---- group: core opening
# The core opening is an issue... TSD doesn't have an opening feature yet...
number_3 = Number(-0.1)
unit_z_3 = UnitZ(Factor=number_3)
solid_union = SolidUnion(Breps=move.Geometry)
extrude_2 = Extrude(Base=surface, Direction=unit_z_3)
solid_difference = SolidDifference(BrepsA=extrude_2, BrepsB=solid_union)
deconstruct_brep_4 = DeconstructBrep(Brep=solid_difference)  # -> Faces, Edges, Vertices
list_item_4 = ListItem(List=deconstruct_brep_4.Faces, Index=Slider(0, range=0..5), Wrap=True)
deconstruct_brep_5 = DeconstructBrep(Brep=list_item_4)  # -> Faces, Edges, Vertices
polyline = PolyLine(Vertices=deconstruct_brep_5.Vertices, Closed=Toggle(True))

# ---- group: Break columns intos ections
columnbreaker = GhPythonScript(surfaces=flatten(surface), curves=cull_index_3)  # -> out, plines, lowest; inputs surfaces: list of Surface, curves: list of Curve
# ---------- columnbreaker: Python ----------
"""Provides a scripting component.
    Inputs:
        x: The x script variable
        y: The y script variable
    Output:
        plines: The a output variable"""

__author__ = "MullerT"
__version__ = "2022.10.01"

import rhinoscriptsyntax as rs
import Rhino as rc

print surfaces.Count
print curves.Count

plines = []
polylines = []

for curve in curves:
    print "curve"
    print curve

    poly = rc.Geometry.Polyline()
    for surface in surfaces:
        print "surface"
        print surface
        result = rs.CurveSurfaceIntersection(curve, surface)
        pointOnCurve = result[0][1]
        print "point on curve"
        print pointOnCurve
        if pointOnCurve:
            print "adding to poly"
            poly.Add(pointOnCurve)
    
    
    print "built poly " +str(poly.Count)
    print poly
    polylines.append(poly)
    
    
print "done..."
print polylines

plines=polylines
# ---------- end columnbreaker ----------
panel_7 = Panel(columnbreaker.out)
explode = Explode(Curve=columnbreaker.plines, Recursive=True)  # -> Segments, Vertices
filter_lowest_lines = GhPythonScript(lines=explode.Segments)  # -> out, top, lowest; inputs lines: list of Line
# ---------- filter_lowest_lines: Python ----------
__author__ = "MullerT"
__version__ = "2022.10.01"

import rhinoscriptsyntax as rs

top =[]
lowest = []

#print lines
print lines[0][0]
print lines[0][1]
lowestZ = lines[0][1][2]
print lowestZ

for line in lines:
    if line[0][2] < lowestZ:
      lowestZ = line[0][2]

for line in lines:
    if line[0][2] == lowestZ:
       lowest.append(line)
    else:
        top.append(line)
        
        
print lowest
print top
# ---------- end filter_lowest_lines ----------
colour_rgb_3 = ColourRGB(Alpha=255, Red=255, Green=150, Blue=50)
custom_preview_3 = CustomPreview(Geometry=[filter_lowest_lines.top, filter_lowest_lines.lowest], Material=colour_rgb_3)

# ---- group: TSD members
concrete_class = ConcreteClass()  # -> ConcreteClass, AllConcreteClasses
diaphragm_option = DiaphragmOption()
thickness = Slider(250, range=150..350)
slab_item_type = SlabItemType()
concrete_column = ConcreteColumn(
    InsertionLine=filter_lowest_lines.lowest,
    Precast=False,
    ConcreteClass="C32/40",
    Section="800 Dia",
    RotationAngle=0,
    AssumeCracked=True,
    AddSupport=True)
concrete_column_2 = ConcreteColumn(
    InsertionLine=filter_lowest_lines.top,
    Precast=False,
    ConcreteClass="C32/40",
    Section="800 Dia",
    RotationAngle=0,
    AssumeCracked=True,
    AddSupport=Toggle(False))
concrete_wall = ConcreteWall(Boundary=cull_index, Precast=False, ThicknessMm="350", ConcreteClass="C32/40", AssumeCracked=True, GenerateSupport=True)
slab_item = SlabItem(
    Boundary=cull_index_2,
    SlabType=slab_item_type,
    DepthMm=thickness,
    MaterialGrade=concrete_class.ConcreteClass,
    RotationAngle=0,
    MeshedIn3D=False,
    DiaphragmOption=diaphragm_option,
    Decomposition=2)

# ---- group: TSD model
# Right click on the model component and select link to TSD to activate the link
number_slider_2 = Slider(4, range=0..10)
area_load = AreaLoad(Panel=slab_item, ValueKNM²=number_slider_2)
loadcase_type = LoadcaseType()
loadcase = Loadcase(
    Title="Office",
    LoadcaseType=loadcase_type,
    IncludeInGenerator=True,
    ImposedLoadReductions=True,
    PanelLoads=flatten(area_load))
combination = Combination(Title="Office Comb", Active=True, Pattern=False, Strength=True, Service=True, Loadcases=flatten(loadcase))
model = Model(
    LineElements=flatten([concrete_column_2, concrete_column]),
    Panels=flatten([slab_item, concrete_wall]),
    Loading=flatten([loadcase, combination]),
    HasTsdData=True)  # -> Model, Loading
analysis = Analysis(Loading=flatten(model.Loading))  # -> AnalysisInfo, Loading
design = Design(Subject="Concrete")  # -> Outcome, AnalysisInfo, Results
member_design_results = MemberDesignResults(Results=design.Results, Member=[concrete_column_2, concrete_column])  # -> MemberStatus, MemberUR, SpanStatuses, SpanURs
panel_8 = Panel(member_design_results.MemberStatus)
